# Grasshopper definition 231205_visiting_geometric_architecture_3.gh (Grasshopper 1.0.7)
# plug-ins: Kangaroo2 Components, Kangaroo Components, TT Toolbox

# ----
# INPUT
gene_pool = GenePool(Decimals=2, Maximum=10000, Minimum=0, Value=[9191.43, 3778.55, 8581.98, 5537.29, 5478.56, 5392.23, 5447.42])
point = Point([Point(147570, 139160, 30970), Point(122320, 2290, 29230), Point(255650, 171990, 30180), Point(47070, 192190, 27560), Point(33930, 34620, 28240), Point(250600, 70980, 34880), Point(48580, 110880, 28880)])

# ----
# INPUT
gene_pool_2 = GenePool(Decimals=2, Maximum=10000, Minimum=0, Value=[10000, 1168.39, 3956.15, 435.09, 4577.27, 2309.61, 4129.74])

# ----
# INPUT
gene_pool_3 = GenePool(Decimals=2, Maximum=10000, Minimum=0, Value=[9191.43, 3778.55, 8581.98, 5537.29, 5478.56, 5392.23, 5447.42])
point_2 = Point([Point(147570, 139160, 5120), Point(47070, 192190, 31270), Point(48580, 110880, 7280), Point(33930, 34620, 35760), Point(122320, 21850, -5480), Point(255650, 171990, 13700), Point(250600, 70980, 13280)])

# ---- group: metaball pull pt
point_3 = Point(Point(-590, 1040, -73100))

# ---- group: Area center pt
point_4 = Point([Point(147570, 139160, 5120), Point(47070, 192190, 31270), Point(48580, 110880, 7280), Point(33930, 34620, 35760), Point(122320, 21850, -5480), Point(255650, 171990, 13700), Point(250600, 70980, 13280)])

# ----
# Kangaroo_TEST
xy_plane = XYPlane(Origin=Point(0, 0, 0))
deconstruct = Deconstruct(Point=point_2)  # -> XComponent, YComponent, ZComponent
rectangular = Rectangular(Plane=xy_plane, SizeX="320000", SizeY="220000", ExtentX="1", ExtentY="1")  # -> Cells, Points
construct_point = ConstructPoint(XCoordinate=deconstruct.XComponent, YCoordinate=deconstruct.YComponent, ZCoordinate="3000")
multiplication = Multiplication(A=gene_pool_3, B=Slider(5, range=0..10))
sphere = Sphere(Base=construct_point, Radius=multiplication)
mesh_plane = MeshPlane(Boundary=rectangular.Cells, WidthCount="90", HeightCount="60")  # -> Mesh, Area
brep_join = BrepJoin(Breps=sphere)  # -> Breps, Closed
deconstruct_mesh = DeconstructMesh(Mesh=mesh_plane.Mesh)  # -> Vertices, Faces, Colours, Normals
nakedvertices = NakedVertices(Mesh=mesh_plane.Mesh)  # -> ClothedIndex, NakedIndex, ClothedPts, NakedPts
point_5 = Point(deconstruct_mesh.Vertices)
point_in_breps = PointInBreps(Brep=brep_join.Breps, Point=point_5, Strict=False)  # -> Inside, Index
dispatch = Dispatch(List=nakedvertices.NakedPts, DispatchPattern=point_in_breps.Inside)  # -> ListA, ListB
unit_z = UnitZ(Factor=1)
point_6 = Point(dispatch.ListA)
edgelengths = EdgeLengths(Mesh=mesh_plane.Mesh, LengthFactor=Slider(1, range=0..1), Strength=1)
show = Show(G=mesh_plane.Mesh)
load = Load(Point=deconstruct_mesh.Vertices, ForceVector=unit_z, Weighting=1)
anchor = Anchor(Point=point_6, Strength=10000)
merge = Merge(Data1=flatten(show), Data2=flatten(edgelengths), Data3=flatten(load), Data4=flatten(anchor))

# ----
# Metaball_TEST
number_slider = Slider(1.754, range=0..10)
unit_z_2 = UnitZ(Factor="2000")
xy_plane_2 = XYPlane(Origin=point_3)
linear_array = LinearArray(Geometry=xy_plane_2, Direction=unit_z_2, Count="300")  # -> Geometry, Transform
multiplication_2 = Multiplication(A=gene_pool_2, B="100000", C=number_slider)
metaball_t_custom = MetaBallTCustom(Points=point_4, Charge=multiplication_2, Plane=linear_array.Geometry, Threshold=0.5)
smooth_polyline = SmoothPolyline(Polyline=metaball_t_custom, Strength=1, Times=1)

curve = Curve(smooth_polyline)

bouncysolver = BouncySolver(GoalObjects=merge, Reset=Button(), Threshold=1e-15, Tolerance=0.0001, Damping=0.99, Iterations=10, On=Toggle(False))  # -> I, V, O
list_item = ListItem(List=bouncysolver.O, Index=0, Wrap=True)

# ----
# Volume_TEST
xy_plane_3 = XYPlane(Origin=Point(0, 0, 0))
division = Division(A="320000", B="30")
division_2 = Division(A="220000", B="20")
multiplication_3 = Multiplication(A=gene_pool, B=Slider(5, range=0..10))
panel = Panel("""30000
-30000""")
project = Project(Geometry=point, Plane=xy_plane_3)  # -> Geometry, Transform
rectangular_2 = Rectangular(Plane=PlaneXY(0, 0, 0), SizeX=division, SizeY=division_2, ExtentX="30", ExtentY="20")  # -> Cells, simplify(flatten(Points))
cylinder = Cylinder(Base=graft(project.Geometry), Radius=graft(multiplication_3), Length=panel)
brep_join_2 = BrepJoin(Breps=cylinder)  # -> Breps, Closed
area = Area(Geometry=rectangular_2.Cells)  # -> Area, flatten(Centroid)
cap_holes = CapHoles(Brep=brep_join_2.Breps)

point_in_breps_2 = PointInBreps(Brep=cap_holes, Point=area.Centroid, Strict=False)  # -> simplify(Inside), Index

dispatch_2 = Dispatch(List=area.Centroid, DispatchPattern=point_in_breps_2.Inside)  # -> ListA, ListB
distance = Distance(PointA=graft(project.Geometry), PointB=dispatch_2.ListA)
division_3 = Division(A=distance, B=Slider(2, range=0..10))
sort_list = SortList(Keys=flatten(division_3))  # -> reverse(Keys), ValuesValuesA
unit_z_3 = UnitZ(Factor=division_3)
list_item_2 = ListItem(List=sort_list.Keys, Index=0, Wrap=True)
reverse = Reverse(Vector=unit_z_3)
unit_z_4 = UnitZ(Factor=list_item_2)
reverse_2 = Reverse(Vector=unit_z_4)
move = Move(Geometry=dispatch_2.ListB, Motion=reverse_2)  # -> flatten(Geometry), Transform
move_2 = Move(Geometry=dispatch_2.ListA, Motion=reverse)  # -> flatten(Geometry), Transform
remove_duplicate_points = RemoveDuplicatePoints(InputPoints=move.Geometry, Tolerance=0.001)  # -> OutputPoints, FirstPointIndexes
remove_duplicate_points_2 = RemoveDuplicatePoints(InputPoints=move_2.Geometry, Tolerance=0.001)  # -> OutputPoints, FirstPointIndexes
clean_tree = CleanTree(RemoveNulls=True, RemoveInvalid=True, RemoveEmpty=False, Tree=remove_duplicate_points.OutputPoints)

point_in_breps_3 = PointInBreps(Brep=flatten(cap_holes), Point=clean_tree, Strict=False)  # -> simplify(Inside), Index
dispatch_3 = Dispatch(List=clean_tree, DispatchPattern=point_in_breps_3.Inside)  # -> ListA, ListB

merge_2 = Merge(Data1=dispatch_3.ListB, Data2=remove_duplicate_points_2.OutputPoints)

point_7 = Point(merge_2)
