# Grasshopper definition blog_Architecture_geometry_study.gh (Grasshopper 1.0.7)
# plug-ins: Kangaroo2 Components, Kangaroo Components, TT Toolbox

# ----
# Volume_TEST
gene_pool = GenePool(Decimals=2, Maximum=10000, Minimum=0, Value=[9191.43, 3778.55, 8581.98, 5537.29, 5478.56, 5392.23, 5447.42])
point = Point([<point referenced from the Rhino model> x7])
xy_plane = XYPlane(Origin=Point(0, 0, 0))
division = Division(A="320000", B="30")
division_2 = Division(A="220000", B="20")
multiplication = Multiplication(A=gene_pool, B=Slider(5, range=0..10))
panel = Panel("""30000
-30000""")
project = Project(Geometry=point, Plane=xy_plane)  # -> Geometry, Transform
rectangular = Rectangular(Plane=PlaneXY(0, 0, 0), SizeX=division, SizeY=division_2, ExtentX="30", ExtentY="20")  # -> Cells, simplify(flatten(Points))
cylinder = Cylinder(Base=graft(project.Geometry), Radius=graft(multiplication), Length=panel)
brep_join = BrepJoin(Breps=cylinder)  # -> Breps, Closed
cap_holes = CapHoles(Brep=brep_join.Breps)
area = Area(Geometry=rectangular.Cells)  # -> Area, flatten(Centroid)
point_in_brep = PointInBrep(Brep=cap_holes, Point=area.Centroid, Strict=False)  # -> simplify(Inside)
dispatch = Dispatch(List=area.Centroid, DispatchPattern=point_in_brep)  # -> ListA, ListB
distance = Distance(PointA=graft(project.Geometry), PointB=dispatch.ListA)
division_3 = Division(A=distance, B=Slider(3, range=0..10))
sort_list = SortList(Keys=flatten(division_3))  # -> reverse(Keys), ValuesValuesA
unit_z = UnitZ(Factor=division_3)
list_item = ListItem(List=sort_list.Keys, Index=0, Wrap=True)
reverse = Reverse(Vector=unit_z)
unit_z_2 = UnitZ(Factor=list_item)
reverse_2 = Reverse(Vector=unit_z_2)
move = Move(Geometry=dispatch.ListA, Motion=reverse)  # -> flatten(Geometry), Transform
move_2 = Move(Geometry=dispatch.ListB, Motion=reverse_2)  # -> flatten(Geometry), Transform
xy_plane_2 = XYPlane(Origin=move.Geometry)
remove_duplicate_points = RemoveDuplicatePoints(InputPoints=move_2.Geometry, Tolerance=0.001)  # -> OutputPoints, FirstPointIndexes
remove_duplicate_points_2 = RemoveDuplicatePoints(InputPoints=move.Geometry, Tolerance=0.001)  # -> OutputPoints, FirstPointIndexes
merge = Merge(Data1=remove_duplicate_points.OutputPoints, Data2=remove_duplicate_points_2.OutputPoints)

# ----
# Metaball_TEST
panel_2 = Panel("2000")
point_2 = Point(<point referenced from the Rhino model>)
point_3 = Point([<point referenced from the Rhino model> x7])
gene_pool_2 = GenePool(Decimals=2, Maximum=10000, Minimum=0, Value=[10000, 1168.39, 3956.15, 435.09, 4577.27, 2309.61, 4129.74])
unit_z_3 = UnitZ(Factor=panel_2)
xy_plane_3 = XYPlane(Origin=point_2)
linear_array = LinearArray(Geometry=xy_plane_3, Direction=unit_z_3, Count="300")  # -> Geometry, Transform
multiplication_2 = Multiplication(A=gene_pool_2, B="100000", C=Slider(1.754, range=0..10))
metaball_t_custom = MetaBallTCustom(Points=point_3, Charge=multiplication_2, Plane=linear_array.Geometry, Threshold=0.5)
smooth_polyline = SmoothPolyline(Polyline=metaball_t_custom, Strength=1, Times=1)

# ----
# Kangaroo_TEST
gene_pool_3 = GenePool(Decimals=2, Maximum=10000, Minimum=0, Value=[9191.43, 3778.55, 8581.98, 5537.29, 5478.56, 5392.23, 5447.42])
point_4 = Point([<point referenced from the Rhino model> x7])
xy_plane_4 = XYPlane(Origin=Point(0, 0, 0))
deconstruct = Deconstruct(Point=point_4)  # -> XComponent, YComponent, ZComponent
rectangular_2 = Rectangular(Plane=xy_plane_4, SizeX="320000", SizeY="220000", ExtentX="1", ExtentY="1")  # -> Cells, Points
construct_point = ConstructPoint(XCoordinate=deconstruct.XComponent, YCoordinate=deconstruct.YComponent, ZCoordinate="3000")
multiplication_3 = Multiplication(A=gene_pool_3, B=Slider(5, range=0..10))
sphere = Sphere(Base=construct_point, Radius=multiplication_3)
mesh_plane = MeshPlane(Boundary=rectangular_2.Cells, WidthCount="90", HeightCount="60")  # -> Mesh, Area
brep_join_2 = BrepJoin(Breps=sphere)  # -> Breps, Closed
deconstruct_mesh = DeconstructMesh(Mesh=mesh_plane.Mesh)  # -> Vertices, Faces, Colours, Normals
nakedvertices = NakedVertices(Mesh=mesh_plane.Mesh)  # -> ClothedIndex, NakedIndex, ClothedPts, NakedPts
point_5 = Point(deconstruct_mesh.Vertices)
point_in_breps = PointInBreps(Brep=brep_join_2.Breps, Point=point_5, Strict=False)  # -> Inside, Index
dispatch_2 = Dispatch(List=nakedvertices.NakedPts, DispatchPattern=point_in_breps.Inside)  # -> ListA, ListB
unit_z_4 = UnitZ(Factor=1)
point_6 = Point(dispatch_2.ListA)
edgelengths = EdgeLengths(Mesh=mesh_plane.Mesh, LengthFactor=Slider(1, range=0..1), Strength=1)
show = Show(G=mesh_plane.Mesh)
load = Load(Point=deconstruct_mesh.Vertices, ForceVector=unit_z_4, Weighting=1)
anchor = Anchor(Point=point_6, Strength=10000)
merge_2 = Merge(Data1=flatten(show), Data2=flatten(edgelengths), Data3=flatten(load), Data4=flatten(anchor))
bouncysolver = BouncySolver(GoalObjects=merge_2, Reset=Button(), Threshold=1e-15, Tolerance=0.0001, Damping=0.99, Iterations=10, On=Toggle(False))  # -> I, V, O
list_item_2 = ListItem(List=bouncysolver.O, Index=0, Wrap=True)
